# Grasshopper definition assembled_speckle.gh (Grasshopper 1.0.7)
# plug-ins: eleFront, Speckle 2, Rhino.Inside for Autodesk Revit, treesloth01, Nautilus

# ---- group: BIMSC-PROJECT
# Send a message to James M. to add
# new materials. This list will be updated
# for all groups to have a common material
# library and common material names.
panel = Panel("ELEMENTAL MARS")
bimsc_project = Text(panel)

# ---- group: RECEIVE MATERIALS
# RECIEVE
# MATERIALS
panel_2 = Panel("https://macad.speckle.xyz/projects/4975f9f0a8/models/d59a568f9e")
receive = Receive(
    Stream=panel_2,
    AutoReceive=False,
    CurrentComponentState="expired",
    ExpandOutput=True,
    LastInfoMessage="James McBennett @ 03/02/2024 01:57:29: Materials 01-03-2024 (id:6ecf38526e)",
    ReceiveOnOpen=False,
    ReceivedCommitId="6ecf38526e",
    StreamWrapper="https://macad.speckle.xyz/streams/4975f9f0a8/branches/d59a568f9e",
    selectedKitName="Objects")  # -> Info, Materials
dso = DeconstructSpeckleObject(SpeckleObject=receive.Materials, selectedKitName="Objects")  # -> Glass, Inflatable, Insulation, Mineral, Regolith, Site, Soil, Steel

# ----
# UNITS
panel_3 = Panel("UnitsRawVolumes")
reflay = ReferenceByLayer(LayerName=panel_3, lightweight=False)
volume = Volume(Geometry=reflay)  # -> Volume, Centroid
int = Integer(volume.Volume)
cset = CreateSet(List=int)  # -> Set, Map
cset_2 = CreateSet(List=cset.Map)  # -> Set, Map
mindex = MemberIndex(Set=cset.Map, Member=cset_2.Set)  # -> Index, Count
item = ListItem(List=reflay, Index=mindex.Index, Wrap=True)  # -> simplify(Item)
bang = ExplodeTree(Data=item)  # -> Branch0, Branch1

# ---- group: FLOOR_LEVELS
# Set your 'Project' name, your 'Group'
# number, your 'Volume' Location that
# connect wirelessly.
series = Series(Start=0, Step=1, Count="5")
expression = Expression(x=series, Expression="Format(\"{0:00}\", x)")
concat = Concatenate(FragmentA="L", FragmentB=expression)  # -> simplify(graft(Result))
floor_levels = Text(concat)

# ----
# filter terrain
# add actual units
panel_4 = Panel("TopoBrep")  # disabled
panel_5 = Panel("Contours")  # disabled
panel_6 = Panel("TopoMesh")  # disabled
panel_7 = Panel("BakedStudioMarsTopoMain")  # disabled
list = ValueList({"AngularDimension", "Arc", "Block", "Brep", "Circle", "Curve", "Dimension", "Ellipse", "Extrusion", "Hatch", "Leader", "Line", "LinearDimension", "Mesh", "Point", "Polyline", "Polysurface", "RadialDimension", "Surface", "Text", "TextDot"}, selected="Mesh")  # disabled
reflay_2 = ReferenceByLayer(LayerName=panel_5, lightweight=False)  # disabled
reflay_3 = ReferenceByLayer(LayerName=panel_4, lightweight=False)  # disabled
reflay_4 = ReferenceByLayer(LayerName=panel_6, lightweight=False)  # disabled
reflay_5 = ReferenceByLayer(LayerName=panel_7, lightweight=False)  # disabled
mesh = MeshBrep(
    Brep=reflay_3,
    Settings={GridMaxCount=0, GridMinCount=16, JaggedSeams=False, MaxEdgeLength=0, MinEdgeLength=0.0001, MinTolerance=0, Refine=True, RefineAngle=0, RelativeTolerance=0.65, SimplePlanes=True, Tolerance=0})  # disabled
filtertype = FilterByType(ObjectType=list, Geometry=reflay_5, invertFilter=False, returnNulls=False)  # -> ExcludedGeometry, IncludedGeometry; disabled
brep = Brep(reflay_3)  # disabled
mesh_2 = Mesh(reflay_4)  # disabled
faceb = FaceBoundaries(Mesh=mesh_2)  # disabled
mesh_3 = Mesh(filtertype.IncludedGeometry)  # disabled
faceb_2 = FaceBoundaries(Mesh=mesh_3)  # disabled
boundary = BoundarySurfaces(Edges=faceb)  # disabled
boundary_2 = BoundarySurfaces(Edges=faceb_2)  # disabled
join = BrepJoin(Breps=boundary)  # -> Breps, Closed; disabled
join_2 = BrepJoin(Breps=boundary_2)  # -> Breps, Closed; disabled

# ---- group: BIMSC-ORIGINATOR
bimsc_originator = Text("G06")

# ---- group: WorksForBrepsAndMeshes
list_2 = ValueList({"Srf/Brep": 0, "Mesh": 1}, selected="Mesh")

# ---- group: BIMSC-VOLUME
bimsc_volume = Text("A4")

# ----
area = Area(Geometry=bang.Branch1)  # -> Area, Centroid
prox = Proximity3D(Points=area.Centroid, Group="2", MaxRadius="5")  # -> simplify(Links), Topology
clean = CleanTree(RemoveNulls=True, RemoveInvalid=True, RemoveEmpty=True, Tree=prox.Links)
tstat = TreeStatistics(Tree=clean)  # -> Paths, Length, Count
duplines = RemoveDuplicateLines(Lines=flatten(clean), Tolerance=0.01)  # -> graft(Lines)
split = SplitTree(Data=simplify(graft(bang.Branch1)), Masks=flatten(tstat.Paths))  # -> graft(Positive), flatten(Negative)
item_2 = ListItem(List=split.Negative, Index="0", Wrap=True)

# ----
# Phasing
# PHASE 2 - HUMANS / MACHINE COLLABORATION
number_slider = Slider(7, range=1..7)
# PHASE 1 - NO HUMANS
series_2 = Series(Start=1, Step=1, Count=number_slider)
item_3 = ListItem(List=series_2, Index=0, Wrap=True)  # -> Item, Item1, Item2, Item3, Item4, Item5, Item6

# ----
# SORTING UNITS BY VOLUME
end = EndPoints(Curve=simplify(duplines))  # -> Start, End
pdecon = Deconstruct(Point=[end.Start, end.End])  # -> XComponent, YComponent, ZComponent
int_2 = Integer(pdecon.ZComponent)
bnd = Bounds(Numbers=int_2)
dedomain = DeconstructDomain(Domain=bnd)  # -> Start, End
equals = Equality(FirstNumber=int_2, SecondNumber=dedomain.Start)  # -> Equality, Inequality
volume_2 = Volume(Geometry=split.Positive)  # -> Volume, simplify(flatten(Centroid))
cull = CullPattern(List=[end.Start, end.End], CullPattern=equals.Equality)
cp = ClosestPoint(Point=cull, Cloud=volume_2.Centroid)  # -> ClosestPoint, CPIndex, Distance
item_4 = ListItem(List=flatten(split.Positive), Index=cp.CPIndex, Wrap=True)
debrep = DeconstructBrep(Brep=item_4)  # -> Faces, Edges, Vertices
area_2 = Area(Geometry=debrep.Faces)  # -> Area, Centroid
pdecon_2 = Deconstruct(Point=area_2.Centroid)  # -> XComponent, YComponent, ZComponent
int_3 = Integer(pdecon_2.ZComponent)
bnd_2 = Bounds(Numbers=int_3)
dedomain_2 = DeconstructDomain(Domain=bnd_2)  # -> Start, End
equals_2 = Equality(FirstNumber=int_3, SecondNumber=dedomain_2.Start)  # -> Equality, Inequality
cull_2 = CullPattern(List=debrep.Faces, CullPattern=equals_2.Equality)  # -> simplify(List)
subtraction = Subtraction(A=dedomain.Start, B=dedomain.End)
wires = BrepWireframe(Brep=cull_2, Density=-1)
division = Division(A=subtraction, B="2")
abs = Absolute(Value=subtraction)
Z = UnitZ(Factor=division)
move = Move(Geometry=cull, Motion=Z)  # -> Geometry, Transform
project = Project(Geometry=wires, Plane=move.Geometry)  # -> simplify(Geometry), Transform

# ---- group: All Blocks for Pods
# UNITS BLOCKS
panel_8 = Panel("Default")
reflay_6 = ReferenceByLayer(LayerName=panel_8, lightweight=False)  # -> simplify(graft(Geometry))
block_info = GetBlockInfo(Block=reflay_6)  # -> Name, simplify(Plane), Transform, BlockType, FilePath, Active
pt = Point(block_info.Plane)

# ---- group: PHASE
# FLOORS
num = Number(item_3.Item3)

num_2 = Number(item_3.Item2)

# EDIT SITE MESH
# TERRAIN
num_3 = Number(item_3.Item)

num_4 = Number(item_3.Item1)

num_5 = Number(item_3.Item4)

num_6 = Number(item_3.Item5)

num_7 = Number(item_3.Item6)

# ---- group: Units_Habi
brep_2 = Brep(Tree({0}: [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], {1}: [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]))

# ---- group: Units_Support
brep_3 = Brep(Tree({0}: [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], {1}: [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]))

# ---- group: All Blocks for Pods / Units Planes
bang_2 = ExplodeTree(Data=pt)  # -> Branch0, Branch1, Branch2

# ----
panel_9 = Panel("https://macad.speckle.xyz/streams/4975f9f0a8/branches/site/04-community-site")
receive_2 = Receive(
    Stream=panel_9,
    AutoReceive=False,
    CurrentComponentState="expired",
    ExpandOutput=True,
    LastInfoMessage="James McBennett @ 03/01/2024 23:14:17: 2024 Mar-01 (id:9ec35295b2)",
    ReceiveOnOpen=False,
    ReceivedCommitId="9ec35295b2",
    StreamWrapper="https://macad.speckle.xyz/streams/4975f9f0a8/branches/site/04-community-site",
    selectedKitName="Objects")  # -> Info, CONTOURS, SOIL
item_5 = ListItem(List=flatten(receive_2.SOIL), Index=Slider(3, range=0..17), Wrap=True)
srf = Surface(<surface referenced from the Rhino model>)
bbox = BoundingBox(Content=srf, Plane=PlaneXY(0, 0, 0))  # -> Box, Box_2
volume_3 = Volume(Geometry=bbox.Box)  # -> Volume, Centroid
msphere = MeshSphere(Base=volume_3.Centroid, Radius="80", UCount="100", VCount="100")
mmx = MeshMesh(MeshA=item_5, MeshB=msphere)
msplit = MeshSplit(Mesh=item_5, Splitters=msphere)

# ----
# WALLS
panel_10 = Panel("Wall")
reflay_7 = ReferenceByLayer(LayerName=panel_10, lightweight=False, DisableAutoUpdate=False)
panel_11 = Panel(reflay_7)
mesh_4 = MeshBrep(
    Brep=reflay_7,
    Settings={GridMaxCount=0, GridMinCount=16, JaggedSeams=False, MaxEdgeLength=0, MinEdgeLength=0.0001, MinTolerance=0, Refine=True, RefineAngle=0, RelativeTolerance=0.65, SimplePlanes=True, Tolerance=0})
brep_4 = Brep(reflay_7)
mjoin = MeshJoin(Meshes=mesh_4)
weld = WeldMesh(Mesh=mjoin, Angle=3.141592654)

# ----
# ROOFS
panel_12 = Panel("Roof")
reflay_8 = ReferenceByLayer(LayerName=panel_12, lightweight=False, DisableAutoUpdate=False)
panel_13 = Panel(reflay_8)
mesh_5 = Mesh(reflay_8)
faceb_3 = FaceBoundaries(Mesh=mesh_5)
boundary_3 = BoundarySurfaces(Edges=faceb_3)
join_3 = BrepJoin(Breps=boundary_3)  # -> Breps, Closed
mesh_6 = Mesh(reflay_8)

reflay_9 = ReferenceByLayer(LayerName="TopoMesh", lightweight=False, DisableAutoUpdate=False)
reflay_10 = ReferenceByLayer(LayerName="TopoBrep", lightweight=False, DisableAutoUpdate=False)
panel_14 = Panel([reflay_9, reflay_10])

reflay_11 = ReferenceByLayer(LayerName="Floors", lightweight=False, DisableAutoUpdate=False)
panel_15 = Panel(reflay_11)
mesh_7 = MeshBrep(
    Brep=reflay_11,
    Settings={GridMaxCount=0, GridMinCount=16, JaggedSeams=False, MaxEdgeLength=0, MinEdgeLength=0.0001, MinTolerance=0, Refine=True, RefineAngle=0, RelativeTolerance=0.65, SimplePlanes=True, Tolerance=0})
brep_5 = Brep(reflay_11)
mjoin_2 = MeshJoin(Meshes=mesh_7)
weld_2 = WeldMesh(Mesh=mjoin_2, Angle=3.141592654)

reflay_12 = ReferenceByLayer(LayerName="Pods", lightweight=False, DisableAutoUpdate=False)
panel_16 = Panel(reflay_12)
mesh_8 = MeshBrep(
    Brep=reflay_12,
    Settings={GridMaxCount=0, GridMinCount=16, JaggedSeams=False, MaxEdgeLength=0, MinEdgeLength=0.0001, MinTolerance=0, Refine=True, RefineAngle=0, RelativeTolerance=0.65, SimplePlanes=True, Tolerance=0})
brep_6 = Brep(reflay_12)
mjoin_3 = MeshJoin(Meshes=mesh_8)
weld_3 = WeldMesh(Mesh=mjoin_3, Angle=3.141592654)

# ---- group: Units_Buffer
brep_7 = Brep(Tree({0}: [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], {1}: [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]))

# ----
end_2 = EndPoints(Curve=project.Geometry)  # -> Start, End
multiplication = Multiplication(A=abs, B="2")
cullpt = CullDuplicates(Points=[end_2.Start, end_2.End], Tolerance=0.1, CullMode=3)  # -> Points, Indices, Valence
pline = PolyLine(Vertices=cullpt.Points, Closed=True)  # -> simplify(Polyline)
Z_2 = UnitZ(Factor=multiplication)
extr = Extrude(Base=pline, Direction=Z_2)
cap = CapHoles(Brep=extr)

# ---- group: Units_Buffer
# UNITS PLANES
debrep_2 = DeconstructBrep(Brep=bang.Branch0)  # -> Faces, Edges, Vertices
area_3 = Area(Geometry=debrep_2.Faces)  # -> Area, Centroid
pdecon_3 = Deconstruct(Point=area_3.Centroid)  # -> XComponent, YComponent, ZComponent
int_4 = Integer(pdecon_3.ZComponent)
bnd_3 = Bounds(Numbers=int_4)
dedomain_3 = DeconstructDomain(Domain=bnd_3)  # -> Start, End
equals_3 = Equality(FirstNumber=int_4, SecondNumber=dedomain_3.Start)  # -> Equality, Inequality
cull_3 = CullPattern(List=area_3.Centroid, CullPattern=equals_3.Equality)  # -> simplify(List)
pln = Plane(flatten(cull_3))

pln_2 = Plane(flatten(cull_3))

# ----
# BUFFER UNITS
bang_3 = ExplodeTree(Data=brep_7)  # -> Branch0, Branch1
sso = BlockDefinition(
    Name="Inflatable",
    Geometry=bang_3.Branch0,
    BasePoint=bang_2.Branch0,
    SelectedConstructorName="Objects.Other.BlockDefinition.ctor(System.String,System.Collections.Generic.List`1[Speckle.Core.Models.Base],Objects.Geometry.Point)",
    SelectedTypeName="Objects.Other.BlockDefinition",
    UseSchemaTag=False,
    UserSetSchemaTag=False,
    seed="e98ffe5e9bfe795355b2")
sso_2 = BlockDefinition(
    Name="Steel",
    Geometry=bang_3.Branch1,
    BasePoint=bang_2.Branch0,
    SelectedConstructorName="Objects.Other.BlockDefinition.ctor(System.String,System.Collections.Generic.List`1[Speckle.Core.Models.Base],Objects.Geometry.Point)",
    SelectedTypeName="Objects.Other.BlockDefinition",
    UseSchemaTag=False,
    UserSetSchemaTag=False,
    seed="19cce9d17a2992b002e5")
orient = Orient(Geometry=bang_2.Branch0, Source=bang_2.Branch0, Target=pln_2)  # -> Geometry, Transform
sso_3 = BlockInstance(
    BlockDefinition=sso,
    Transform=orient.Transform,
    SelectedConstructorName="Objects.Other.BlockInstance.ctor(Objects.Other.BlockDefinition,Objects.Other.Transform)",
    SelectedTypeName="Objects.Other.BlockInstance",
    UseSchemaTag=False,
    UserSetSchemaTag=False,
    seed="6ac40892a254094ba5bf")
sso_4 = BlockInstance(
    BlockDefinition=sso_2,
    Transform=orient.Transform,
    SelectedConstructorName="Objects.Other.BlockInstance.ctor(Objects.Other.BlockDefinition,Objects.Other.Transform)",
    SelectedTypeName="Objects.Other.BlockInstance",
    UseSchemaTag=False,
    UserSetSchemaTag=False,
    seed="56e02fcb1ef79a18a3fe")
name = ExtendSpeckleObject(
    SpeckleObject=sso_3,
    BIMSCPROJECT=bimsc_project,
    BIMSCORIGINATOR=bimsc_originator,
    BIMSCVOLUME=bimsc_volume,
    BIMSCTYPE="INFLATABLES",
    BIMSCMATERIAL="Inflatable",
    RenderMaterial=dso.Inflatable,
    BIMSCPHASE=num_4,
    selectedKitName="Objects")
name_2 = ExtendSpeckleObject(
    SpeckleObject=sso_4,
    BIMSCPROJECT=bimsc_project,
    BIMSCORIGINATOR=bimsc_originator,
    BIMSCVOLUME=bimsc_volume,
    BIMSCTYPE="STRUCTURE",
    BIMSCMATERIAL="Steel",
    RenderMaterial=dso.Steel,
    BIMSCPHASE=num_4,
    selectedKitName="Objects")
in = CreateSpeckleObject(Inflatables=name, Structure=name_2, selectedKitName="Objects")

# ----
# MERGE UNITS
in_2 = CreateSpeckleObject(Units_Buffer=in, selectedKitName="Objects")

# ---- group: Units_Support
debrep_3 = DeconstructBrep(Brep=cap)  # -> Faces, Edges, Vertices
area_4 = Area(Geometry=debrep_3.Faces)  # -> Area, Centroid
pdecon_4 = Deconstruct(Point=area_4.Centroid)  # -> XComponent, YComponent, ZComponent
int_5 = Integer(pdecon_4.ZComponent)
bnd_4 = Bounds(Numbers=int_5)
dedomain_4 = DeconstructDomain(Domain=bnd_4)  # -> Start, End
equals_4 = Equality(FirstNumber=int_5, SecondNumber=dedomain_4.Start)  # -> Equality, Inequality
cull_4 = CullPattern(List=area_4.Centroid, CullPattern=equals_4.Equality)  # -> simplify(List)
pln_3 = Plane(flatten(cull_4))

pln_4 = Plane(flatten(cull_4))

# ---- group: Units_Habi
debrep_4 = DeconstructBrep(Brep=split.Negative)  # -> Faces, Edges, Vertices
area_5 = Area(Geometry=debrep_4.Faces)  # -> Area, Centroid
pdecon_5 = Deconstruct(Point=area_5.Centroid)  # -> XComponent, YComponent, ZComponent
int_6 = Integer(pdecon_5.ZComponent)
bnd_5 = Bounds(Numbers=int_6)
dedomain_5 = DeconstructDomain(Domain=bnd_5)  # -> Start, End
equals_5 = Equality(FirstNumber=int_6, SecondNumber=dedomain_5.Start)  # -> Equality, Inequality
cull_5 = CullPattern(List=area_5.Centroid, CullPattern=equals_5.Equality)  # -> simplify(List)
pln_5 = Plane(flatten(cull_5))

pln_6 = Plane(flatten(cull_5))

# ---- group: LEVEL
txt = Text(Tree({0}: ["L00"], {1}: ["L04"]))

floor_levels_2 = Text(floor_levels)

# ----
filter = StreamFilter(Gate=list_2, Stream0=reflay_10, Stream1=reflay_9)
msplit_2 = MeshSplit(Mesh=filter, Splitters=msphere)
item_6 = ListItem(List=msplit_2, Index=Slider(1, range=0..1), Wrap=True)
name_3 = ExtendSpeckleObject(
    SpeckleObject=item_6,
    BIMSCPROJECT=bimsc_project,
    BIMSCORIGINATOR=bimsc_originator,
    BIMSCVOLUME=bimsc_volume,
    BIMSCLEVEL=floor_levels_2,
    BIMSCTYPE="TERRAIN",
    BIMSCMATERIAL="soil",
    RenderMaterial=dso.Soil,
    BIMSCPHASE=num_3,
    selectedKitName="Objects")  # -> flatten(ExtendedSpeckleObject)

# ---- group: LEVEL
floor_levels_3 = Text(floor_levels)

# ----
filter_2 = StreamFilter(Gate=list_2, Stream0=brep_5, Stream1=weld_2)
name_4 = ExtendSpeckleObject(
    SpeckleObject=filter_2,
    BIMSCPROJECT=bimsc_project,
    BIMSCORIGINATOR=bimsc_originator,
    BIMSCVOLUME=bimsc_volume,
    BIMSCLEVEL=floor_levels_3,
    BIMSCTYPE="FLOORS",
    BIMSCMATERIAL="Regolith",
    RenderMaterial=dso.Regolith,
    BIMSCPHASE=num_4,
    selectedKitName="Objects")  # -> flatten(ExtendedSpeckleObject)

filter_3 = StreamFilter(Gate=list_2, Stream0=brep_4, Stream1=weld)  # -> reverse(simplify(graft(Stream)))
name_5 = ExtendSpeckleObject(
    SpeckleObject=filter_3,
    BIMSCPROJECT=bimsc_project,
    BIMSCORIGINATOR=bimsc_originator,
    BIMSCVOLUME=bimsc_volume,
    BIMSCLEVEL=txt,
    BIMSCTYPE="WALLS",
    BIMSCMATERIAL="Regolith",
    RenderMaterial=dso.Regolith,
    BIMSCPHASE=num_6,
    selectedKitName="Objects")

# ---- group: LEVEL
floor_levels_4 = Text(floor_levels)

# ----
item_7 = ListItem(List=msplit, Index=Slider(0, range=0..1), Wrap=True)
name_6 = ExtendSpeckleObject(
    SpeckleObject=item_7,
    BIMSCPROJECT=bimsc_project,
    BIMSCORIGINATOR=bimsc_originator,
    BIMSCVOLUME=bimsc_volume,
    BIMSCLEVEL=floor_levels_4,
    BIMSCTYPE="SITE",
    BIMSCMATERIAL="soil",
    RenderMaterial=dso.Soil,
    BIMSCPHASE=num_3,
    selectedKitName="Objects")  # -> flatten(ExtendedSpeckleObject)

# ---- group: LEVEL
floor_levels_5 = Text(floor_levels)

# ----
filter_4 = StreamFilter(Gate=list_2, Stream0=brep_6, Stream1=weld_3)
name_7 = ExtendSpeckleObject(
    SpeckleObject=filter_4,
    BIMSCPROJECT=bimsc_project,
    BIMSCORIGINATOR=bimsc_originator,
    BIMSCVOLUME=bimsc_volume,
    BIMSCLEVEL=floor_levels_5,
    BIMSCTYPE="PODS",
    BIMSCMATERIAL="Regolith",
    RenderMaterial=dso.Regolith,
    BIMSCPHASE=num_2,
    selectedKitName="Objects")  # -> flatten(ExtendedSpeckleObject)

# ---- group: LEVEL
floor_levels_6 = Text(floor_levels)

# ----
# UNITS
filter_5 = StreamFilter(Gate=list_2)
name_8 = ExtendSpeckleObject(
    SpeckleObject=filter_5,
    BIMSCPROJECT=bimsc_project,
    BIMSCORIGINATOR=bimsc_originator,
    BIMSCVOLUME=bimsc_volume,
    BIMSCLEVEL=floor_levels_6,
    BIMSCTYPE="UNIT STRUCTURE",
    BIMSCMATERIAL="Steel",
    RenderMaterial=dso.Steel,
    BIMSCPHASE=num,
    selectedKitName="Objects")  # -> flatten(ExtendedSpeckleObject)

# ---- group: LEVEL
floor_levels_7 = Text(floor_levels)

# ----
filter_6 = StreamFilter(Gate=list_2)
name_9 = ExtendSpeckleObject(
    SpeckleObject=filter_6,
    BIMSCPROJECT=bimsc_project,
    BIMSCORIGINATOR=bimsc_originator,
    BIMSCVOLUME=bimsc_volume,
    BIMSCLEVEL=floor_levels_7,
    BIMSCTYPE="UNITS INFLATABLE",
    BIMSCMATERIAL="Inflatable",
    RenderMaterial=dso.Insulation,
    BIMSCPHASE=num_5,
    selectedKitName="Objects")  # -> flatten(ExtendedSpeckleObject)

# ---- group: LEVEL
txt_2 = Text(Tree({0}: ["L00"], {1}: ["L04"]))

# ----
filter_7 = StreamFilter(Gate=list_2, Stream0=join_3.Breps, Stream1=mesh_6)  # -> reverse(simplify(graft(Stream)))
name_10 = ExtendSpeckleObject(
    SpeckleObject=filter_7,
    BIMSCPROJECT=bimsc_project,
    BIMSCORIGINATOR=bimsc_originator,
    BIMSCVOLUME=bimsc_volume,
    BIMSCLEVEL=txt_2,
    BIMSCTYPE="ROOF",
    BIMSCMATERIAL="Inflatable",
    RenderMaterial=dso.Inflatable,
    BIMSCPHASE=num_7,
    selectedKitName="Objects")

# ----
# 01 //Create Revit Materials from Rhino M Properties
trigger = Trigger(Interval=1000, TimerInterval=1000, Target=[material, graphics])  # disabled

# ----
# 02// Create New Unit Revit Family
trigger_2 = Trigger(Interval=1000, TimerInterval=1000, Target=[new, famform, materials, active])  # disabled

# ----
# SEND TO REVIT MODEL
# The figures in the circles from the trigger component
# for the revit families to work have to be from left to right:
# a triangle (play), a pointer (mouse), and a key.
# //Send Topo Meshes to Revit
trigger_3 = Trigger(Interval=1000, TimerInterval=1000, Target=topography)  # disabled

# ----
# 03//Add Units to Revit
trigger_4 = Trigger(Interval=1000, TimerInterval=1000, Target=[types, l_component, l_component_2, l_component_3])  # disabled

# ----
# G06 wip branch
# https://macad.speckle.xyz/projects/4975f9f0a8/models/0c407c0907
panel_17 = Panel("G06_WIPdModel_V5")

# ----
# G06 shared branch
panel_18 = Panel("G06_AssembledModel_V4")
panel_19 = Panel("https://macad.speckle.xyz/streams/4975f9f0a8/branches/shared%2Fg06")

# ----
# G06_test_Unreal
# https://macad.speckle.xyz/streams/5e4e4e4563
panel_20 = Panel("G06_UnrealdModel_V1")

# ----
# G6_STUDIO_MAIN_MODEL
# https://macad.speckle.xyz/projects/4975f9f0a8/models/37a2354197
panel_21 = Panel("G06_AssembledModel_V4")

# ----
# //Send topo meshes to Revit
number_slider_2 = Slider(9, range=0..10)
mesh_9 = Mesh(reflay_9)
unweld = UnweldMesh(Mesh=mesh_9, Angle=degrees(number_slider_2))
topography = AddTopographyMesh(Mesh=unweld, TrackingMode=2)  # disabled

# ----
# //Send block instances to Revit
listblockd = ListBlocksInDocument(fullName=True)
refblock = ReferenceBlockByName(BlockName=listblockd, getNestedBlocks=False, lightweight=False, DisableAutoUpdate=False)
item_8 = ListItem(List=refblock, Index=0, Wrap=True)
block_info_2 = GetBlockInfo(Block=item_8)  # -> Name, Plane, Transform, BlockType, FilePath, Active
orient_2 = Orient(Geometry=item_8, Source=block_info_2.Plane, Target=PlaneXY(0, 0, 0))  # -> Geometry, Transform
expblock = ExplodeBlock(Block=orient_2.Geometry, recursive=False)  # -> Name, Transform, Geometry

# ----
# //Query materials' names using Elefront
geo = Geometry(expblock.Geometry)
ef_att = EleFrontAttributes(Attributes=geo)
ef_layer = EleFrontLayer(Layer=ef_att)
ef_layer_2 = EleFrontLayer(Layer=ef_layer)

split_2 = TextSplit(Text=ef_layer, Separators="::")
item_9 = ListItem(List=split_2, Index=-1, Wrap=True)
concat_2 = Concatenate(FragmentA="M-", FragmentB=item_9)  # -> simplify(Result)
pshift = ShiftPaths(Data=concat_2, Offset=-1)

# ----
# 02// Create new component family
materials = QueryMaterials(Name=pshift)  # disabled
add_link_to_revit_family_in_from_your_la = Panel("C:\Users\ARoncal\OneDrive - Thornton Tomasetti, Inc\__License Resources\Desktop\G06_studio_2024\Final\documentation\FTemplate_GEN_.rft")  # "Add Link to Revit Family in from your laptop. [Final / Documentation]"; disabled
famform = ComponentFamilyForm(Brep=graft(geo), Material=materials)  # disabled
active = ActiveDocument()  # disabled
toggle = BooleanToggle(True)  # disabled
shift = ShiftPaths(Data=famform, Offset=-1)  # disabled
new = NewComponentFamily(
    Document=active,
    Template=add_link_to_revit_family_in_from_your_la,
    Overwrite=toggle,
    Name=simplify(expblock.Name),
    Geometry=simplify(shift))  # disabled

# ----
# 03//Add components to RH Planes
types = QueryTypes(Document=active, Kind=3, FamilyName=expblock.Name)  # disabled
bang_4 = ExplodeTree(Data=types)  # -> Branch0, Branch1, Branch2; disabled
l_component = AddComponentLocation(Document=active, Location=simplify(pln), Type=simplify(bang_4.Branch0), TrackingMode=2)  # disabled
l_component_2 = AddComponentLocation(Document=active, Location=simplify(pln_5), Type=simplify(bang_4.Branch1), TrackingMode=2)  # disabled
l_component_3 = AddComponentLocation(Document=active, Location=simplify(pln_3), Type=simplify(bang_4.Branch2), TrackingMode=2)  # disabled

# ----
# SEND TO SPLECKLE STREAMS
cso = CreateSpeckleObject(
    ROOF=name_10,
    WALL=name_5,
    FLOORS=name_4,
    PODS=name_7,
    UNITS=in_2,
    TERRAIN=name_3,
    SITE_A4=name_6,
    selectedKitName="Objects")

# ----
# Always Leave Send Component Unplugged
# in the stream input before closing and
# saving this gh file
send = Send(
    Stream=panel_19,
    Message=panel_18,
    D=cso,
    AutoSend=False,
    BaseId="81f03236b71b13f63b781442c5bde320",
    CurrentComponentState="up_to_date",
    KitName="Objects",
    OutputWrappers="https://macad.speckle.xyz\t677b44128b\tcb70638a05",
    UseDefaultCache=True,
    selectedKitName="Objects")  # disabled

rec = DataRecorder(send, DataLimit=-10, RecordData=True)
panel_22 = Panel(rec)

# ----
# 01 //Create Revit materials from Rhino M Properties
cset_3 = CreateSet(List=flatten(pshift))  # -> Set, Map; disabled
material = AddMaterial(Name=cset_3.Set, TrackingMode=2)  # disabled

# ---- group: MaterialProperties
python = GhPythonScript(Mname=cset_3.Set)  # -> out, Pvalue, Pname; disabled
# ---------- python: Python ----------
__author__ = "hesham.shawqy"
__version__ = "2024.02.25"

import rhinoscriptsyntax as rs
import Rhino.DocObjects as rd
import Rhino as rh

def get_material_properties(Mname):
    # Get the active Rhino document
    doc = rh.RhinoDoc.ActiveDoc
    
    # Search for the material by name
    material_index = doc.Materials.Find(Mname, True)
    if material_index < 0:
        print("Material not found.")
        return None
    
    # Retrieve the material object
    material = doc.Materials[material_index]
    
    # Extract material properties
    properties = {
        "DiffuseColor": material.DiffuseColor,
        "Transparency": material.Transparency,
        # Add more properties as needed
    }
    
    return properties

Pname = []
Pvalue = []
material_properties = get_material_properties(Mname)
if material_properties:
    for prop, value in material_properties.items():
        Pvalue.append(value)
        Pname.append(prop)
# ---------- end python ----------

# ----
item_10 = ListItem(List=simplify(python.Pvalue), Index=0, Wrap=True)  # -> Item, Item1; disabled
graphics = MaterialGraphics(
    Material=simplify(graft(material)),
    Color=item_10.Item,
    Transparency=item_10.Item1,
    ForegroundPatternCutPatterns=<geometry referenced from the Revit model>)  # -> Material, UseRenderAppearance, Color, Transparency, SurfacePatternsForegroundPattern, SurfacePatternsForegroundColor, CutPatternsForegroundPattern, CutPatternsForegroundColor; disabled
